# Grasshopper definition foamCOREdaisyDRIVERroot3.gh (Grasshopper 0.9.76)
# Copyright: Creative Commons 3.0 nc by sa
# plug-ins: LunchBox

width_of_cuff_device = Slider(3.1, range=0..10)  # disabled
distance_between_wing_roots = Slider(-1.85, range=-6..0)  # disabled
crv = Curve(<curve referenced from the Rhino model>)  # disabled
neg = Negative(Value=width_of_cuff_device)  # disabled
Y = UnitY(Factor=[width_of_cuff_device, neg])  # disabled
addition = Addition(A=width_of_cuff_device, B=distance_between_wing_roots)  # disabled
subtraction = Subtraction(A=neg, B=distance_between_wing_roots)  # disabled

# ---- group: lead to tail rod position
number_slider = Slider(1.04, range=0..10)  # disabled
number_slider_2 = Slider(-0.05, range=-1..1)  # disabled
number_slider_3 = Slider(0.24, range=0..1)  # disabled
number_slider_4 = Slider(0.24, range=0..1)  # disabled
bbox = BoundingBox(Content=crv, Plane=PlaneXY(0, 0, 0))  # -> Box, Box_2; disabled
panel = Panel("""0.5
0.5""")  # disabled
box = EvaluateBox(
    Box=bbox.Box,
    UParameter=[number_slider, number_slider_2],
    VParameter=panel,
    WParameter=[number_slider_4, number_slider_3])  # -> Plane, Point, Include; disabled
dispatch = Dispatch(List=box.Point, DispatchPattern=[True, False])  # -> ListA, ListB; disabled
ln = Line(StartPoint=dispatch.ListA, EndPoint=dispatch.ListB)  # disabled

# ----
Y_2 = UnitY(Factor=[addition, subtraction])  # disabled
move = Move(Geometry=crv, Motion=Y_2)  # -> Geometry, Transform; disabled

# ---- group: wings
outer_wing_length = Slider(70, range=0..100)  # disabled
inner_wing_length = Slider(-26, range=-65..-1)  # disabled
patch = PatchSurface(EdgeCurves=graft(move.Geometry), U=2, V=2, Tolerance=0.001)  # -> flatten(PatchSurface); disabled
dispatch_2 = Dispatch(List=patch, DispatchPattern=[True, False])  # -> ListA, ListB; disabled
Y_3 = UnitY(Factor=outer_wing_length)  # disabled
Y_4 = UnitY(Factor=inner_wing_length)  # disabled
swatch = ColourSwatch(SwatchColor=RGBA(108, 212, 118, 165))  # disabled
swatch_2 = ColourSwatch(SwatchColor=RGBA(217, 76, 76, 111))  # disabled
extr = Extrude(Base=dispatch_2.ListA, Direction=Y_3)  # disabled
extr_2 = Extrude(Base=dispatch_2.ListB, Direction=Y_4)  # disabled
preview = CustomPreview(Geometry=extr_2, Shader=swatch_2)  # disabled
preview_2 = CustomPreview(Geometry=extr, Shader=swatch)  # disabled

# ---- group: socket for wings
number_slider_5 = Slider(0.05, range=0..0.1)  # disabled
offset = Offset(Curve=move.Geometry, Distance=number_slider_5, Plane=PlaneXY(0, 0, 0), Corners=1)  # -> flatten(Curve); disabled
patch_2 = PatchSurface(EdgeCurves=graft(offset), U=2, V=2, Tolerance=0.001)  # -> flatten(PatchSurface); disabled
dispatch_3 = Dispatch(List=patch_2, DispatchPattern=[True, False])  # -> ListA, ListB; disabled
extr_3 = Extrude(Base=dispatch_3.ListA, Direction=Y_3)  # disabled
extr_4 = Extrude(Base=dispatch_3.ListB, Direction=Y_4)  # disabled

# ---- group: arc pipe for main ring = radius 152cm
number_slider_6 = Slider(0.391, range=0.2..0.6)  # disabled
curvepoint = PointOnCurve(ln, parameter=0.5)  # disabled
Y_5 = UnitY(Factor=number_slider_6)  # disabled
move_2 = Move(Geometry=curvepoint, Motion=Y_5)  # -> Geometry, Transform; disabled
number_slider_7 = Slider(152, range=0..1000)  # disabled
arc = Arc3Pt(PointA=dispatch.ListA, PointB=move_2.Geometry, PointC=dispatch.ListB)  # -> Arc, Plane, Radius; disabled
circle = Circle3Pt(PointA=dispatch.ListA, PointB=move_2.Geometry, PointC=dispatch.ListB)  # -> Circle, Plane, Radius; disabled
panel_2 = Panel(arc.Radius)  # disabled
equals = Equality(FirstNumber=arc.Radius, SecondNumber=number_slider_7)  # -> Equality, Inequality; disabled
number_slider_8 = Slider(1.24, range=1..4)  # disabled
number_slider_9 = Slider(0.8, range=0..1)  # disabled
pipe = Pipe(Curve=arc.Arc, Radius=number_slider_8, Caps=0)  # disabled
pipe_2 = Pipe(Curve=arc.Arc, Radius=number_slider_9, Caps=0)  # disabled

# ----
geo = Geometry([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])

# ---- group: forward spar rod hole size
number_slider_10 = Slider(23.3, range=0..30)
number_slider_11 = Slider(-10.1, range=-41..12)
bbox_2 = BoundingBox(Content=geo, Plane=PlaneXY(0, 0, 0))  # -> Box, Box_2
box_2 = EvaluateBox(
    Box=bbox_2.Box,
    UParameter=[Slider(0.14, range=0..1), Slider(0.14, range=0..1)],
    VParameter=[number_slider_10, number_slider_11],
    WParameter=[Slider(0.61, range=0..1), Slider(0.61, range=0..1)])  # -> Plane, Point, Include
dispatch_4 = Dispatch(List=box_2.Point, DispatchPattern=[True, False])  # -> ListA, ListB
ln_2 = Line(StartPoint=dispatch_4.ListA, EndPoint=dispatch_4.ListB)
pipe_3 = Pipe(Curve=ln_2, Radius=Slider(0.32, range=0..2), Caps=0)
join = BrepJoin(Breps=pipe_3)  # -> Breps, Closed

# ---- group: Rear spar rod hole size
bbox_3 = BoundingBox(Content=geo, Plane=PlaneXY(0, 0, 0))  # -> Box, Box_2
box_3 = EvaluateBox(
    Box=bbox_3.Box,
    UParameter=[Slider(0.48, range=0..1), Slider(0.48, range=0..1)],
    VParameter=[number_slider_10, number_slider_11],
    WParameter=[Slider(0.66, range=0..1), Slider(0.66, range=0..1)])  # -> Plane, Point, Include
dispatch_5 = Dispatch(List=box_3.Point, DispatchPattern=[True, False])  # -> ListA, ListB
ln_3 = Line(StartPoint=dispatch_5.ListA, EndPoint=dispatch_5.ListB)
pipe_4 = Pipe(Curve=ln_3, Radius=Slider(0.32, range=0..2), Caps=0)
join_2 = BrepJoin(Breps=pipe_4)  # -> Breps, Closed

# ----
number_slider_12 = Slider(3.93, range=0..6)  # disabled
number_slider_13 = Slider(-1.21, range=-1.5..1)  # disabled
Z = UnitZ(Factor=number_slider_13)  # -> flatten(UnitVector); disabled
cap = CapHoles(Brep=pipe_2)  # disabled
number_slider_14 = Slider(-0.4, range=-1..1)  # disabled
cap_2 = CapHoles(Brep=pipe)  # disabled
cap_3 = CapHoles(Brep=join.Breps)
cap_4 = CapHoles(Brep=join_2.Breps)
Y_6 = UnitY(Factor=number_slider_14)  # disabled
yz = YZPlane(Origin=Point(0, 0, 0))  # disabled
brep = Brep(flatten([cap_3, cap_4]))
preview_3 = CustomPreview(Geometry=[cap_3, cap_4], Shader=ColourSwatch(SwatchColor=RGBA(97, 80, 49, 233)))
geo_2 = Geometry(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)
sdiff = SolidDifference(BrepsA=geo_2, BrepsB=brep)
preview_4 = CustomPreview(Geometry=sdiff, Shader=ColourSwatch(SwatchColor=RGBA(35, 64, 99, 155)))

# ---- group: Fat Cuff Profile
thickness_of_cuff = Slider(0.26, range=0..1)  # disabled
xz = XZPlane(Origin=Point(0, 0, 0))  # disabled
offset_2 = Offset(Curve=crv, Distance=thickness_of_cuff, Plane=xz, Corners=1)  # disabled
patch_3 = PatchSurface(EdgeCurves=offset_2, U=2, V=2, Tolerance=0.001)  # disabled
extr_5 = Extrude(Base=patch_3, Direction=Y)  # disabled

# ----
sunion = SolidUnion(Breps=flatten([extr_5, cap_2]))  # disabled

# ---- group: ring compression sleeve tensioning hoops
number_slider_15 = Slider(1.27, range=0..1.9)  # disabled
number_slider_16 = Slider(0.18, range=0..1.9)  # disabled
number_slider_17 = Slider(0.95, range=0..1)  # disabled
number_slider_18 = Slider(0.05, range=0..1)  # disabled
pframe = PerpFrame(Curve=reparameterize(arc.Arc), Parameter=number_slider_17)  # disabled
pframe_2 = PerpFrame(Curve=reparameterize(arc.Arc), Parameter=number_slider_18)  # disabled
torus = TorusSurface(
    UDivisions=90,
    VDivisions=96,
    CParameter=number_slider_12,
    RParameter=number_slider_15,
    TParameter=1,
    Scale=number_slider_16,
    Domain1=Domain(0, 6.283185307),
    Domain2=Domain(-3.141592654, 3.141592654))  # disabled

# ----
prot = RotatePlane(Plane=[pframe, pframe_2], Angle=degrees(90))  # -> flatten(Plane); disabled

# ---- group: ring compression sleeve tensioning hoops (continued)
move_3 = Move(Geometry=prot, Motion=graft(Z))  # -> flatten(Geometry), Transform; disabled
orient = Orient(Geometry=torus, Source=yz, Target=move_3.Geometry)  # -> Geometry, Transform; disabled

# ----
move_4 = Move(Geometry=move_3.Geometry, Motion=graft(Y_6))  # -> flatten(Geometry), Transform; disabled
sunion_2 = SolidUnion(Breps=flatten([orient.Geometry, sunion]))  # disabled

# ---- group: Fat Cuff Profile (continued)
sdiff_2 = SolidDifference(BrepsA=sunion_2, BrepsB=cap)  # disabled

# ----
sdiff_3 = SolidDifference(BrepsA=sdiff_2, BrepsB=extr_3)  # disabled
sdiff_4 = SolidDifference(BrepsA=sdiff_3, BrepsB=extr_4)  # disabled
